# Grasshopper definition Evolutionary Algorithm and Greedy Algorithm for SL-Blocks.gh (Grasshopper 1.0.7)
# plug-ins: Yellow, HoopSnake, treesloth01, SurfaceTrails2, Pufferfish

# ---- group: action
actions = Panel("""h
a
d
s
t
y""")  # disabled
cset = CreateSet(List=actions)  # -> Set, Map; disabled

# ---- group: tansformation rules
cluster = Cluster()  # disabled
transform = Transform(cluster)  # disabled

# ---- group: choose model
list = ValueList({"0", "1"}, selected="0")  # disabled
simple_sl = Geometry(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)  # disabled
refined_sl = Geometry(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)  # disabled
p_n_c = PickNChoose(Pattern=list, Stream0=simple_sl, Stream1=refined_sl)  # disabled

# ---- group: action
actions_2 = Panel("""h
a
d
s
t
y""")  # disabled
cset_2 = CreateSet(List=actions_2)  # -> Set, Map; disabled

# ----
# Greedy Algorithm
number_slider = Slider(0.3, range=0..1)  # disabled
button = Button()  # disabled
panel = Panel("h")  # disabled

# ----
# Evolutionary Algorithm
genes = GenePool(Decimals=0, Maximum=5, Minimum=0, Value=[1, 1, 1, 0, 2, 2, 3, 0, 1, 0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])  # disabled
item = ListItem(List=cset.Set, Action=genes, Wrap=False)  # disabled
galapagos = Galapagos()

rules = Panel("""i
h
a
d
s
t
y""")  # disabled
chars = Characters(Text=item)  # -> flatten(Result), Unicode; disabled
cset_3 = CreateSet(List=rules)  # -> Set, Map; disabled
mindex = MemberIndex(Set=cset_3.Set, Member=chars.Result)  # -> flatten(Index), Count; disabled
item_2 = ListItem(List=transform, Index=mindex.Index, Wrap=True)  # disabled
s = Slider(0.3, range=0..10)  # disabled
c_script = CSharpScript(transX=item_2)  # -> out, TransformList; inputs transX: list of Transform; disabled
# ---------- c_script: C# ----------
    List < Transform > nTransX = new List <Transform>();

    Transform tx = Transform.Identity;
    for (int i = 0; i < transX.Count; i++)
    {
      tx = Transform.Multiply(tx, transX[i]);
      nTransX.Add(tx);
    }

    TransformList = nTransX;
# ---------- c_script: C# additional code ----------
  /// <summary>
  /// This method will be called once every solution, before any calls to RunScript.
  /// </summary>
  public override void BeforeRunScript()
  { }
  /// <summary>
  /// This method will be called once every solution, after any calls to RunScript.
  /// </summary>
  public override void AfterRunScript()
  { }
# ---------- end c_script ----------
transform_2 = Transform(Geometry=p_n_c, Transform=c_script.TransformList)  # disabled
scale = Scale(Geometry=transform_2, Center=Point(0, 0, 0), SizeOfSLBlock=s)  # -> Geometry, Transform; disabled

# ---- group: check the collision
ungroup = Ungroup(Group=scale.Geometry)  # disabled
voxgeom = VoxelizeGeometry(Geometry=ungroup, Size=s)  # -> flatten(Mesh); disabled
volume = Volume(Geometry=voxgeom)  # -> Volume, Centroid; disabled
lng = ListLength(List=volume.Centroid)  # disabled
intersection = SetIntersection(SetA=volume.Centroid, SetB=volume.Centroid)  # disabled
lng_2 = ListLength(List=intersection)  # disabled
panel_2 = Panel("""not collision
collision""")  # disabled
smaller = SmallerThan(FirstNumber=lng_2, SecondNumber=lng)  # -> SmallerThan, OrEqualTo; disabled
item_3 = ListItem(List=panel_2, Index=smaller.SmallerThan, Wrap=True)  # disabled
panel_3 = Panel(item_3)  # disabled

# ---- group: Display_sequential assembly of SL-blocks
cluster_2 = Cluster_2(text=mindex.Index)  # disabled
gradient = Gradient(
    LowerLimit=0.1,
    UpperLimit=0.9,
    Parameter=cluster_2,
    stops=[0: RGB(192, 255, 255), 0.0832: RGB(128, 255, 255), 0.196: RGB(0, 255, 255), 0.199: RGB(135, 206, 250), 0.199: RGB(102, 220, 250), 0.3: RGB(176, 224, 230), 0.407: RGB(80, 193, 222), 0.477: RGB(2, 137, 186), 0.521: RGB(135, 206, 235), 0.615: RGB(73, 163, 252)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])  # disabled
preview = CustomPreview(Geometry=scale.Geometry, Material=gradient)  # disabled

# ----
number_slider_2 = Slider(7, range=0..10)  # disabled
panel_4 = Panel("0")  # disabled
actions_3 = Panel("""h
a
d
s
t
y""")  # disabled
cset_4 = CreateSet(List=actions_3)  # -> Set, Map; disabled

cluster_3 = Cluster()  # disabled
rules_2 = Panel("""i
h
a
d
s
t
y""")  # disabled
cset_5 = CreateSet(List=rules_2)  # -> Set, Map; disabled
transform_3 = Transform(cluster_3)  # disabled
simple_sl_2 = Geometry(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)  # disabled

target_curves = TargetCurves()  # -> _2d_curve_short_2, _2d_curve_long_2, _3d_curve_open_short_2, _3d_curve_open_long_2, _3d_curve_closed_short_2, _3d_curve_closed_long_2; disabled
crv = Curve(target_curves._3d_curve_closed_long_2)  # disabled
data = Data(scale.Geometry)  # disabled
bbox = BoundingBox(Content=data, Plane=PlaneXY(0, 0, 0))  # -> Box, Box_2; disabled
volume_2 = Volume(Geometry=bbox.Box)  # -> Volume, Centroid; disabled
crv_cp = CurveClosestPoint(Point=volume_2.Centroid, Curve=crv)  # -> Point, Parameter, Distance; disabled
multiplication = Multiplication(A=crv_cp.Distance, _100=100)  # disabled
filter = StreamFilter(Gate=smaller.SmallerThan, Stream0=crv_cp.Distance, Stream1=multiplication)  # disabled

# ---- group: display of distances between each engagement and curve
ungroup_2 = Ungroup(Group=scale.Geometry)  # disabled
voxgeom_2 = VoxelizeGeometry(Geometry=ungroup_2, Size=s)  # -> simplify(Mesh); disabled
edges = BrepEdges(Brep=ungroup_2)  # -> Naked, Interior, NonManifold; disabled
path_mapper = PathMapper(voxgeom_2, source="{A;B}", target="{A}")  # disabled
volume_3 = Volume(Geometry=path_mapper)  # -> Volume, Centroid; disabled
crv_cp_2 = CurveClosestPoint(Point=volume_3.Centroid, Curve=crv)  # -> Point, Parameter, Distance; disabled
sort = SortList(Keys=crv_cp_2.Distance)  # -> Keys, ValuesA; disabled
first_last = FirstLast(List=sort.Keys)  # -> flatten(FirstValue), LastValue; disabled

# ----
ma = MassAddition(Input=filter)  # -> Result, PartialResults; disabled

num = Number(ma.Result)  # disabled
panel_5 = Panel(num)  # disabled

# ---- group: display of distances between each engagement and curve
gradient_2 = Gradient(
    LowerLimit=0,
    UpperLimit=1,
    Parameter=first_last.FirstValue,
    stops=[0.247: RGB(240, 248, 255), 0.497: RGB(255, 255, 0), 0.755: RGB(255, 128, 0)])  # disabled
preview_2 = CustomPreview(Geometry=scale.Geometry, Material=gradient_2)  # disabled

# ----
number_slider_3 = Slider(42, range=0..100)  # disabled
target_curves_2 = TargetCurves()  # -> _2d_curve_short_2, _2d_curve_long_2, _3d_curve_open_short_2, _3d_curve_open_long_2, _3d_curve_closed_short_2, _3d_curve_closed_long_2; disabled
crv_2 = Curve(target_curves_2._3d_curve_closed_long_2)  # disabled
divide = DivideCurve(Curve=crv_2, Count=number_slider_3, Kinks=False)  # -> Points, Tangents, Parameters; disabled
shift = ShiftList(List=divide.Points, Shift=9, Wrap=True)  # disabled

# ---- group: check the collision of all
panel_6 = Panel("""not collision
collision""")  # disabled

# ---- group: check the collision with previous block
panel_7 = Panel("""not collision
collision""")  # disabled

# ----
actions_4 = Panel("""a
d
s
t
y
h""")  # disabled
number_slider_4 = Slider(98, range=0..100)  # disabled
panel_8 = Panel("h")  # disabled

# ---- group: display of distances between each engagement and curve
cluster_4 = Cluster()  # disabled
rules_3 = Panel("""i
h
a
d
s
t
y""")  # disabled
cset_6 = CreateSet(List=rules_3)  # -> Set, Map; disabled
transform_4 = Transform(cluster_4)  # disabled
simple_sl_3 = Geometry(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)  # disabled

# ----
hs = HoopSnake(
    StartingData=panel,
    Data=filter_6,
    Hoopsnake_Data_autoUpdate=False,
    Hoopsnake_Data_dataLimit=2147483647,
    Hoopsnake_Data_delay=0,
    Hoopsnake_Data_resetCounter=True,
    Hoopsnake_Data_updateView=True)  # -> Feedback, CumulativeFeedback, LoopsCounter, IterationsCounter; disabled

mod = Modulus(A=hs.IterationsCounter, B=number_slider_2)  # disabled
equals = Equality(FirstNumber=mod, SecondNumber=6)  # -> Equality, Inequality; disabled
bool = Boolean(mod)  # disabled
filter_2 = StreamFilter(Gate=equals.Equality, Stream0=mod, Stream1=panel_4)  # disabled
not = GateNot(A=bool)  # disabled
item_4 = ListItem(List=cset_2.Set, Action=filter_2, Wrap=False)  # disabled
concat = Concatenate(FragmentA=hs.Feedback, FragmentB=item_4)  # -> simplify(Result); disabled
chars_2 = Characters(Text=concat)  # -> Result, Unicode; disabled
mindex_2 = MemberIndex(Set=cset_4.Set, Member=chars_2.Result)  # -> Index, Count; disabled

chars_3 = Characters(Text=concat)  # -> flatten(Result), Unicode; disabled
mindex_3 = MemberIndex(Set=cset_5.Set, Member=chars_3.Result)  # -> flatten(Index), Count; disabled
item_5 = ListItem(List=transform_3, Index=mindex_3.Index, Wrap=True)  # disabled
c_script_2 = CSharpScript(transX=item_5)  # -> out, TransformList; inputs transX: list of Transform; disabled; same code as c_script
transform_5 = Transform(Geometry=simple_sl_2, Transform=c_script_2.TransformList)  # disabled
scale_2 = Scale(Geometry=transform_5, Center=Point(0, 0, 0), SizeOfSLBlock=number_slider)  # -> Geometry, Transform; disabled

# ---- group: check the collision of all (continued)
ungroup_3 = Ungroup(Group=scale_2.Geometry)  # disabled
voxgeom_3 = VoxelizeGeometry(Geometry=ungroup_3, Size=number_slider)  # -> flatten(Mesh); disabled
volume_4 = Volume(Geometry=voxgeom_3)  # -> Volume, Centroid; disabled
intersection_2 = SetIntersection(SetA=volume_4.Centroid, SetB=volume_4.Centroid)  # disabled
lng_3 = ListLength(List=volume_4.Centroid)  # disabled
lng_4 = ListLength(List=intersection_2)  # disabled
smaller_2 = SmallerThan(FirstNumber=lng_4, SecondNumber=lng_3)  # -> SmallerThan, OrEqualTo; disabled
item_6 = ListItem(List=panel_6, Index=smaller_2.SmallerThan, Wrap=True)  # disabled
panel_9 = Panel(item_6)  # disabled

# ---- group: Display_sequential assembly of SL-blocks
cluster_5 = Cluster_2(text=mindex_2.Index)  # disabled
gradient_3 = Gradient(
    LowerLimit=0.1,
    UpperLimit=0.9,
    Parameter=cluster_5,
    stops=[0: RGB(192, 255, 255), 0.0832: RGB(128, 255, 255), 0.196: RGB(0, 255, 255), 0.199: RGB(135, 206, 250), 0.199: RGB(102, 220, 250), 0.3: RGB(176, 224, 230), 0.407: RGB(80, 193, 222), 0.477: RGB(2, 137, 186), 0.521: RGB(135, 206, 235), 0.615: RGB(73, 163, 252)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])  # disabled
preview_3 = CustomPreview(Geometry=scale_2.Geometry, Material=gradient_3)  # disabled

# ----
lng_5 = ListLength(List=chars_3.Result)  # disabled
subtraction = Subtraction(A=lng_5, B=1)  # disabled
item_7 = ListItem(List=shift, Index=subtraction, Wrap=True)  # disabled

lastdex = LastIndex(List=scale_2.Geometry)  # disabled
first_last_2 = FirstLast(List=scale_2.Geometry)  # -> FirstValue, LastValue; disabled
cull_i = CullIndex(List=scale_2.Geometry, Indices=lastdex, Wrap=True)  # disabled
ungroup_4 = Ungroup(Group=first_last_2.LastValue)  # disabled
voxgeom_4 = VoxelizeGeometry(Geometry=ungroup_4, Size=number_slider)  # -> flatten(Mesh); disabled
volume_5 = Volume(Geometry=voxgeom_4)  # -> Volume, Centroid; disabled

data_2 = Data(first_last_2.LastValue)  # disabled
bbox_2 = BoundingBox(Content=data_2, Plane=PlaneXY(0, 0, 0))  # -> Box, Box_2; disabled
volume_6 = Volume(Geometry=bbox_2.Box)  # -> Volume, Centroid; disabled

dist = Distance(PointA=volume_6.Centroid, PointB=item_7)  # disabled
addition = Addition(A=dist, _100=100)  # disabled
panel_10 = Panel(dist)  # disabled

# ---- group: check the collision with previous block (continued)
ungroup_5 = Ungroup(Group=cull_i)  # disabled
voxgeom_5 = VoxelizeGeometry(Geometry=ungroup_5, Size=number_slider)  # -> flatten(Mesh); disabled
volume_7 = Volume(Geometry=voxgeom_5)  # -> Volume, Centroid; disabled
intersection_3 = SetIntersection(SetA=volume_7.Centroid, SetB=volume_7.Centroid)  # disabled
lng_6 = ListLength(List=volume_7.Centroid)  # disabled
lng_7 = ListLength(List=intersection_3)  # disabled
smaller_3 = SmallerThan(FirstNumber=lng_7, SecondNumber=lng_6)  # -> SmallerThan, OrEqualTo; disabled
item_8 = ListItem(List=panel_7, Index=smaller_3.SmallerThan, Wrap=True)  # disabled
panel_11 = Panel(item_8)  # disabled

# ----
intersection_4 = SetIntersection(SetA=volume_7.Centroid, SetB=volume_5.Centroid)  # disabled
lng_8 = ListLength(List=intersection_4)  # disabled
larger = LargerThan(FirstNumber=lng_8, SecondNumber=0)  # -> LargerThan, OrEqualTo; disabled

or = GateOr(A=smaller_2.SmallerThan, B=larger.LargerThan)  # disabled

filter_3 = StreamFilter(Gate=or, Stream0=dist, Stream1=addition)  # disabled
resettablerecorder = ResettableDataRecorder(Data=filter_3, Reset=not, Clear=not)  # disabled
panel_12 = Panel(resettablerecorder)  # disabled
lng_9 = ListLength(List=panel_12)  # disabled
equals_2 = Equality(FirstNumber=lng_9, SecondNumber=6)  # -> Equality, Inequality; disabled
filter_4 = StreamFilter(Gate=equals_2.Equality, Stream1=panel_12)  # disabled
sort_2 = SortList(Keys=filter_4)  # -> Keys, ValuesA; disabled
fsim = FindSimilarMember(Data=sort_2.Keys, Set=panel_12)  # -> Hit, Index; disabled
first_last_3 = FirstLast(List=sort_2.Keys)  # -> FirstValue, LastValue; disabled
first_last_4 = FirstLast(List=fsim.Index)  # -> FirstValue, LastValue; disabled
python = GhPythonScript(x=first_last_3.FirstValue)  # -> out, a; disabled
# ---------- python: Python ----------
__author__ = "de_li"
__version__ = "2021.02.02"

import rhinoscriptsyntax as rs

if x>1:
    a=True
else:
    a=False
# ---------- end python ----------
item_9 = ListItem(List=actions_4, Index=first_last_4.FirstValue, Wrap=True)  # disabled
filter_5 = StreamFilter(Gate=equals_2.Equality, Stream1=item_9)  # disabled
data_rec = PythonScript(x=filter_5, enable=True, reset=button, limit=number_slider_4)  # -> x; inputs x: tree, enable: Boolean, reset: Boolean, limit: Int32; disabled
# ---------- data_rec: Python ----------
from Grasshopper import DataTree
if reset or 'rec' not in globals(): rec = DataTree[object]()
if enable and not reset: rec.MergeTree(x)
if limit > 0:
  for branch in rec.Branches:
    if branch.Count > limit:
      branch.RemoveRange(0, branch.Count - limit)
x = rec
# ---------- end data_rec ----------
join = TextJoin(Text=data_rec)  # disabled
concat_2 = Concatenate(FragmentA=panel_8, FragmentB=join)  # disabled
panel_13 = Panel(concat_2)  # disabled
filter_6 = StreamFilter(Gate=python.a, Stream0=panel_13, Stream1=panel)  # disabled

# ---- group: display of distances between each engagement and curve (continued)
chars_4 = Characters(Text=panel_13)  # -> flatten(Result), Unicode; disabled
mindex_4 = MemberIndex(Set=cset_6.Set, Member=chars_4.Result)  # -> flatten(Index), Count; disabled
item_10 = ListItem(List=transform_4, Index=mindex_4.Index, Wrap=True)  # disabled
c_script_3 = CSharpScript(transX=item_10)  # -> out, TransformList; inputs transX: list of Transform; disabled; same code as c_script
transform_6 = Transform(Geometry=simple_sl_3, Transform=c_script_3.TransformList)  # disabled
scale_3 = Scale(Geometry=transform_6, Center=Point(0, 0, 0), SizeOfSLBlock=number_slider)  # -> Geometry, Transform; disabled
ungroup_6 = Ungroup(Group=scale_3.Geometry)  # disabled
edges_2 = BrepEdges(Brep=ungroup_6)  # -> Naked, Interior, NonManifold; disabled
voxgeom_6 = VoxelizeGeometry(Geometry=ungroup_6, Size=number_slider)  # -> simplify(Mesh); disabled
path_mapper_2 = PathMapper(voxgeom_6, source="{A;B}", target="{A}")  # disabled
volume_8 = Volume(Geometry=path_mapper_2)  # -> Volume, Centroid; disabled
crv_cp_3 = CurveClosestPoint(Point=volume_8.Centroid, Curve=crv_2)  # -> Point, Parameter, Distance; disabled
sort_3 = SortList(Keys=crv_cp_3.Distance)  # -> Keys, ValuesA; disabled
first_last_5 = FirstLast(List=sort_3.Keys)  # -> flatten(FirstValue), LastValue; disabled

gradient_4 = Gradient(
    LowerLimit=0,
    UpperLimit=1,
    Parameter=first_last_5.FirstValue,
    stops=[0.247: RGB(240, 248, 255), 0.497: RGB(255, 255, 0), 0.755: RGB(255, 128, 0)])  # disabled
preview_4 = CustomPreview(Geometry=scale_3.Geometry, Material=gradient_4)  # disabled

# ==== cluster Cluster

# ---- group: y
yz = YZPlane(Origin=Point(0, 0, 0))
pi = Pi(Factor=1)
xy = XYPlane(Origin=Point(0, 0, 0))
pi_2 = Pi(Factor="0.5")
vec = VectorXYZ(XComponent="1", YComponent="1", ZComponent="-2")  # -> Vector, Length
rotate = Rotate(Angle=pi, Plane=yz)  # -> Geometry, Transform
rotate_2 = Rotate(Angle=pi_2, Plane=xy)  # -> Geometry, Transform
move = Move(Motion=vec.Vector)  # -> Geometry, Transform
merge = Merge(Data1=rotate_2.Transform, Data2=move.Transform)
comp = Compound(Transforms=merge)

# ---- group: s
yz_2 = YZPlane(Origin=Point(0, 0, 0))
pi_3 = Pi(Factor=1)
pi_4 = Pi(Factor="0.5")
xy_2 = XYPlane(Origin=Point(0, 0, 0))
vec_2 = VectorXYZ(XComponent="1", YComponent="1", ZComponent="-1")  # -> Vector, Length
rotate_3 = Rotate(Angle=pi_3, Plane=yz_2)  # -> Geometry, Transform
rotate_4 = Rotate(Angle=pi_4, Plane=xy_2)  # -> Geometry, Transform
move_2 = Move(Motion=vec_2.Vector)  # -> Geometry, Transform
merge_2 = Merge(Data1=rotate_3.Transform, Data2=rotate_4.Transform, Data3=move_2.Transform)
comp_2 = Compound(Transforms=merge_2)

# ---- group: t
yz_3 = YZPlane(Origin=Point(0, 0, 0))
pi_5 = Pi(Factor=1)
pi_6 = Pi(Factor="-0.5")
xy_3 = XYPlane(Origin=Point(0, 0, 0))
vec_3 = VectorXYZ(XComponent="1", YComponent="-1", ZComponent="1")  # -> Vector, Length
rotate_5 = Rotate(Angle=pi_5, Plane=yz_3)  # -> Geometry, Transform
rotate_6 = Rotate(Angle=pi_6, Plane=xy_3)  # -> Geometry, Transform
move_3 = Move(Motion=vec_3.Vector)  # -> Geometry, Transform
merge_3 = Merge(Data1=rotate_5.Transform, Data2=rotate_6.Transform, Data3=move_3.Transform)
comp_3 = Compound(Transforms=merge_3)

# ----
matrix = Matrix(graft([{0;0=1, 0;1=0, 0;2=0, 0;3=0, 1;0=0, 1;1=1, 1;2=0, 1;3=0, 2;0=0, 2;1=0, 2;2=1, 2;3=0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}, {0;0=1, 0;1=0, 0;2=0, 0;3=2, 1;0=0, 1;1=-1, 1;2=0, 1;3=0, 2;0=0, 2;1=0, 2;2=-1, 2;3=0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}, {0;0=0, 0;1=1, 0;2=0, 0;3=1, 1;0=-1, 1;1=0, 1;2=0, 1;3=-1, 2;0=0, 2;1=0, 2;2=1, 2;3=0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}, {0;0=1, 0;1=0, 0;2=0, 0;3=2, 1;0=0, 1;1=1, 1;2=0, 1;3=0, 2;0=0, 2;1=0, 2;2=1, 2;3=-1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}, {0;0=0, 0;1=1, 0;2=0, 0;3=1, 1;0=-1, 1;1=0, 1;2=0, 1;3=1, 2;0=0, 2;1=0, 2;2=1, 2;3=-1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}, {0;0=0, 0;1=-1, 0;2=0, 0;3=1, 1;0=1, 1;1=0, 1;2=0, 1;3=-1, 2;0=0, 2;1=0, 2;2=1, 2;3=1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}, {0;0=0, 0;1=-1, 0;2=0, 0;3=1, 1;0=1, 1;1=0, 1;2=0, 1;3=1, 2;0=0, 2;1=0, 2;2=1, 2;3=-2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}]))
matrix_2 = DisplayMatrix(comp_2)
bang = ExplodeTree(Data=matrix)  # -> flatten(Branch0), flatten(Branch1), flatten(Branch2), flatten(Branch3), flatten(Branch4), flatten(Branch5), flatten(Branch6)
transform = Transform(bang.Branch2)
transform_2 = Transform(bang.Branch0)
transform_3 = Transform(bang.Branch1)
transform_4 = Transform(bang.Branch3)
transform_5 = Transform(comp_2)
transform_6 = Transform(comp_3)
transform_7 = Transform(comp)
merge_4 = Merge(
    Data1=transform_2,
    Data2=transform_3,
    Data3=transform,
    Data4=transform_4,
    Data5=transform_5,
    Data6=transform_6,
    Data7=transform_7)  # -> flatten(Result)
R = ClusterOutput(merge_4)

# ==== cluster Cluster_2
text = ClusterInput()

# ---- group: Display
characters = Characters(Text=text)  # -> flatten(Result), Unicode
list_length = ListLength(List=characters.Result)
construct_domain = ConstructDomain(DomainStart=0, DomainEnd=list_length)
series = Series(Start=0, Step=1, Count=list_length)
remap_numbers = RemapNumbers(Value=series, Source=construct_domain, Target=Domain(0, 1))  # -> Mapped, Clipped

# ----
mapped = ClusterOutput(remap_numbers.Mapped)

# ==== cluster TargetCurves
_2d_curve_short = Curve(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)
_2d_curve_long = Curve(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)
_3d_curve_open_short = Curve(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)
_3d_curve_open_long = Curve(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)
_3d_curve_closed_short = Curve(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)
_3d_curve_closed_long = Curve(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)
_2d_curve_short_2 = ClusterOutput(_2d_curve_short)
_2d_curve_long_2 = ClusterOutput(_2d_curve_long)
_3d_curve_open_short_2 = ClusterOutput(_3d_curve_open_short)
_3d_curve_closed_short_2 = ClusterOutput(_3d_curve_closed_short)
_3d_curve_closed_long_2 = ClusterOutput(_3d_curve_closed_long)
_3d_curve_open_long_2 = ClusterOutput(_3d_curve_open_long)
