# Grasshopper definition Reinforcement Learning Interface.gh (Grasshopper 1.0.7)
# plug-ins: HoopSnake, Pufferfish, SurfaceTrails2

# ---- group: size of sl-block
s = Slider(0.3, range=0..10)  # disabled
division = Division(A=3, B=s)  # disabled

# ---- group: define training curves
# In this case,you should move the drawn curve to the starting block.
target_curves = TargetCurves()  # -> _2d_curve_short_2, _2d_curve_long_2, _3d_curve_open_short_2, _3d_curve_open_long_2, _3d_curve_closed_short_2, _3d_curve_closed_long_2; disabled
crv = Curve(target_curves._2d_curve_long_2)  # disabled

# ---- group: size of sl-block
s_2 = Slider(0.3, range=0..10)
division_2 = Division(A=3, B=s_2)

# ---- group: define training curves
# In this case,you should move the drawn curve to the starting block.
target_curves_2 = TargetCurves()  # -> _2d_curve_short_2, _2d_curve_long_2, _3d_curve_open_short_2, _3d_curve_open_long_2, _3d_curve_closed_short_2, _3d_curve_closed_long_2
crv_2 = Curve(target_curves_2._2d_curve_short_2)

# ---- group: size of sl-block
s_3 = Slider(0.3, range=0..10)  # disabled
division_3 = Division(A=3, B=s_3)  # disabled

# ---- group: define training curves
# In this case,you should move the drawn curve to the starting block.
target_curves_3 = TargetCurves()  # -> _2d_curve_short_2, _2d_curve_long_2, _3d_curve_open_short_2, _3d_curve_open_long_2, _3d_curve_closed_short_2, _3d_curve_closed_long_2; disabled
crv_3 = Curve(target_curves_3._3d_curve_open_long_2)  # disabled

# In this case,you should move the drawn curve to the starting block.
target_curves_4 = TargetCurves()  # -> _2d_curve_short_2, _2d_curve_long_2, _3d_curve_open_short_2, _3d_curve_open_long_2, _3d_curve_closed_short_2, _3d_curve_closed_long_2; disabled
crv_4 = Curve(target_curves_4._3d_curve_open_short_2)  # disabled

# ---- group: size of sl-block
s_4 = Slider(0.3, range=0..10)  # disabled
division_4 = Division(A=3, B=s_4)  # disabled

s_5 = Slider(0.3, range=0..10)  # disabled
division_5 = Division(A=3, B=s_5)  # disabled

# ---- group: define training curves
# In this case,you should move the drawn curve to the starting block.
target_curves_5 = TargetCurves()  # -> _2d_curve_short_2, _2d_curve_long_2, _3d_curve_open_short_2, _3d_curve_open_long_2, _3d_curve_closed_short_2, _3d_curve_closed_long_2; disabled
crv_5 = Curve(target_curves_5._3d_curve_closed_long_2)  # disabled

# ---- group: size of sl-block
s_6 = Slider(0.3, range=0..10)  # disabled
division_6 = Division(A=3, B=s_6)  # disabled

# ---- group: define training curves
# In this case,you should move the drawn curve to the starting block.
target_curves_6 = TargetCurves()  # -> _2d_curve_short_2, _2d_curve_long_2, _3d_curve_open_short_2, _3d_curve_open_long_2, _3d_curve_closed_short_2, _3d_curve_closed_long_2; disabled
crv_6 = Curve(target_curves_6._3d_curve_closed_short_2)  # disabled

# ----
# Reinforcement Learning__2D long curve open
initial_state = Slider(0, range=0..6)  # disabled

# ----
# Reinforcement Learning__2D short curve open
initial_state_2 = Slider(0, range=0..6)

# ---- group: maximum allowed distance
number_slider = Slider(8, range=0..10)  # disabled
division_7 = Division(A=number_slider, B=division)  # disabled

# ----
# Observation
number_slider_2 = Slider(24, range=0..100)

# ---- group: maximum allowed distance
division_8 = Division(A=Slider(6, range=0..10), B=division_2)

# ----
number_slider_3 = Slider(42, range=0..48)  # disabled
number_slider_4 = Slider(0.2, range=0..10)  # disabled
divide = DivideCurve(Curve=crv, Count=number_slider_3, Kinks=False)  # -> Points, Tangents, Parameters; disabled
points = PointList(Points=divide.Points, Size=number_slider_4)  # disabled

divide_2 = DivideCurve(Curve=crv_2, Count=number_slider_2, Kinks=False)  # -> Points, Tangents, Parameters
points_2 = PointList(Points=divide_2.Points, Size=Slider(0.2, range=0..10))

# ---- group: positive reward
# Reward Design
number_slider_5 = Slider(1, range=0..1)  # disabled

# Reward Function
number_slider_6 = Slider(1, range=0..1)

# ---- group: punishment2
punishment1 = Panel("0")  # disabled

# ---- group: punishment1
punishment1_2 = Panel("0")  # disabled

# ---- group: punishment2
punishment1_3 = Panel("0")

# ---- group: punishment1
punishment1_4 = Panel("0")

# ---- group: display of distances between each engagement and curve
button = Button()  # disabled

# ----
# Reinforcement Learning__3D long curve open
initial_state_3 = Slider(0, range=0..6)  # disabled

# ----
# Reinforcement Learning__3D short curve open
initial_state_4 = Slider(0, range=0..6)  # disabled

# ---- group: maximum allowed distance
number_slider_7 = Slider(9, range=0..10)  # disabled
division_9 = Division(A=number_slider_7, B=division_3)  # disabled

# ----
number_slider_8 = Slider(48, range=0..48)  # disabled
number_slider_9 = Slider(0.2, range=0..10)  # disabled
divide_3 = DivideCurve(Curve=crv_3, Count=number_slider_8, Kinks=False)  # -> reverse(Points), Tangents, Parameters; disabled
points_3 = PointList(Points=divide_3.Points, Size=number_slider_9)  # disabled

# ---- group: maximum allowed distance
number_slider_10 = Slider(9, range=0..10)  # disabled
division_10 = Division(A=number_slider_10, B=division_4)  # disabled

# ----
number_slider_11 = Slider(24, range=0..48)  # disabled
number_slider_12 = Slider(0.2, range=0..10)  # disabled
divide_4 = DivideCurve(Curve=crv_4, Count=number_slider_11, Kinks=False)  # -> Points, Tangents, Parameters; disabled
points_4 = PointList(Points=divide_4.Points, Size=number_slider_12)  # disabled

# ---- group: positive reward
# Reward Function
number_slider_13 = Slider(1, range=0..1)  # disabled

# Reward Function
number_slider_14 = Slider(1, range=0..1)  # disabled

# ---- group: punishment2
punishment1_5 = Panel("0")  # disabled

# ---- group: punishment1
punishment1_6 = Panel("0")  # disabled

# ---- group: punishment2
punishment1_7 = Panel("0")  # disabled

# ---- group: punishment1
punishment1_8 = Panel("0")  # disabled

# ---- group: display of distances between each engagement and curve
button_2 = Button()  # disabled

button_3 = Button()  # disabled

# ----
# Reinforcement Learning__3D long curve closed
initial_state_5 = Slider(0, range=0..6)  # disabled

# ----
# Reinforcement Learning__3D short curve closed
initial_state_6 = Slider(0, range=0..6)  # disabled

# ---- group: maximum allowed distance
number_slider_15 = Slider(9, range=0..10)  # disabled
division_11 = Division(A=number_slider_15, B=division_5)  # disabled

number_slider_16 = Slider(6, range=0..10)  # disabled
division_12 = Division(A=number_slider_16, B=division_6)  # disabled

# ----
number_slider_17 = Slider(42, range=0..50)  # disabled
number_slider_18 = Slider(10, range=0..10)  # disabled
number_slider_19 = Slider(0.2, range=0..10)  # disabled
divide_5 = DivideCurve(Curve=crv_5, Count=number_slider_17, Kinks=False)  # -> Points, Tangents, Parameters; disabled
shift = ShiftList(List=divide_5.Points, Shift=number_slider_18, Wrap=True)  # disabled
points_5 = PointList(Points=shift, Size=number_slider_19)  # disabled

number_slider_20 = Slider(24, range=0..48)  # disabled
number_slider_21 = Slider(5, range=0..10)  # disabled
number_slider_22 = Slider(0.2, range=0..10)  # disabled
divide_6 = DivideCurve(Curve=crv_6, Count=number_slider_20, Kinks=False)  # -> Points, Tangents, Parameters; disabled
shift_2 = ShiftList(List=divide_6.Points, Shift=number_slider_21, Wrap=True)  # disabled
points_6 = PointList(Points=shift_2, Size=number_slider_22)  # disabled

# ---- group: positive reward
# Reward Function
number_slider_23 = Slider(1, range=0..1)  # disabled

# Reward Function
number_slider_24 = Slider(1, range=0..1)  # disabled

# ---- group: punishment2
punishment1_9 = Panel("0")  # disabled

punishment1_10 = Panel("0")  # disabled

# ---- group: punishment1
punishment1_11 = Panel("0")  # disabled

punishment1_12 = Panel("0")  # disabled

# ---- group: display of distances between each engagement and curve
button_4 = Button()  # disabled

button_5 = Button()  # disabled

# ----
observation = Panel(merge_2)  # disabled

observation_2 = Panel(merge_5)

string_of_sequential_assembly = Panel(cluster2.result_2)  # disabled
action = Panel(agent.action)  # disabled
reward = Panel(filter_3)  # disabled

hs = HoopSnake(
    StartingData=initial_state,
    Data=filter_4,
    Hoopsnake_Data_autoUpdate=False,
    Hoopsnake_Data_dataLimit=2147483647,
    Hoopsnake_Data_delay=0,
    Hoopsnake_Data_resetCounter=True,
    Hoopsnake_Data_updateView=True)  # -> Feedback, CumulativeFeedback, LoopsCounter, IterationsCounter; disabled
agent = GhPythonScript(iter=hs.IterationsCounter)  # -> action, reset; disabled
# ---------- agent: Python ----------
__author__ = "boris"
__version__ = "2020.08.24"

import rhinoscriptsyntax as rs
import scriptcontext as sc

import socket
import struct
import pickle

class Connection:
    def __init__(self, s):
        self._socket = s
        self._buffer = ""

    def receive_object(self):
        while len(self._buffer) < 4 or len(self._buffer) < struct.unpack("<L", self._buffer[:4])[0] + 4:
            new_bytes = self._socket.recv(16)
            if len(new_bytes) == 0:
                return None
            self._buffer += new_bytes
        length = struct.unpack("<L", self._buffer[:4])[0]
        header, body = self._buffer[:4], self._buffer[4:length + 4]
        obj = pickle.loads(body)
        self._buffer = self._buffer[length + 4:]
        return obj

    def send_object(self, d):
        body = pickle.dumps(d)
        header = struct.pack("<L", len(body))
        msg = header + body
        self._socket.send(msg)


# Connection
if iter == 0:
    addr = ("127.0.0.1", 50710)
    agent_socket = socket.socket(socket.AF_INET, socket.SOCK_STREAM)
    agent_socket.connect(addr)
    agent_conn = Connection(agent_socket)
    # Reset
    msg_in = agent_conn.receive_object()
    if msg_in == "reset":
        reset = True
    else:
        raise RuntimeError("First message must be 'reset'")
else:
    # Send message
    msg_out = {"observation": sc.sticky["observation"],
               "reward": sc.sticky["reward"],
               "done": sc.sticky["done_inp"],
               "info": sc.sticky["info"]}
    agent_conn.send_object(msg_out)
    # Receive message
    msg_in = agent_conn.receive_object()
    if msg_in == "reset":
        reset = True
    elif msg_in == "close":
        reset = True
        agent_socket.close()
        #sc.sticky["enabled"] = False
    else:
        action = msg_in
# ---------- end agent ----------
cluster2 = Cluster2(size_of_sl_block=s, text=hs.Feedback, action=agent.action)  # -> geometry, matrix_values_2, result_2, result; disabled

# ----
# Reset Function
# the reset function returns the environment to the initial state when the current action is not allowed.
check_the_collision = CheckTheCollision(size=s, list=cluster2.geometry)  # disabled

lng = ListLength(List=cluster2.geometry)  # disabled
series = Series(Start=lng, Step=1, Count=3)  # disabled
min = Minimum(A=series, B=40)  # disabled
item = ListItem(List=divide.Points, Index=min, Wrap=True)  # disabled
pdecon = Deconstruct(Point=item)  # -> XComponent, YComponent, ZComponent; disabled
panel = Panel(pdecon.XComponent)  # disabled
panel_2 = Panel(pdecon.YComponent)  # disabled
panel_3 = Panel(pdecon.ZComponent)  # disabled
multiplication = Multiplication(A=panel, _025=0.25)  # disabled
multiplication_2 = Multiplication(A=panel_2, _025=0.25)  # disabled
multiplication_3 = Multiplication(A=panel_3, _008=0.08)  # disabled
merge = Merge(Data1=multiplication, Data2=multiplication_2, Data3=multiplication_3)  # disabled

cluster = Cluster_3(list=cluster2.geometry, scale_size=s, curve=crv, first_number=hs.IterationsCounter, previous_number=cluster2.result)  # -> i, distance, state_of_reset_2; disabled
state_of_reset = Data(cluster.state_of_reset_2)  # disabled
minimum_distance = Data(cluster.i)  # disabled
observation_distance = Data(cluster.distance)  # disabled

# ----
# Observation
panel_4 = Panel(cluster2.matrix_values_2)  # disabled
merge_2 = Merge(Data1=flatten(merge), Data2=flatten(observation_distance), Data3=flatten(panel_4))  # -> simplify(flatten(Result)); disabled

# ---- group: maximum allowed distance (continued)
larger = LargerThan(FirstNumber=minimum_distance, SecondNumber=division_7)  # -> LargerThan, OrEqualTo; disabled

# ---- group: Rest
or = GateOr(A=check_the_collision, B=larger.LargerThan)  # disabled

# ---- group: punishment1 (continued)
or_2 = GateOr(A=larger.LargerThan)  # disabled
data = Data(or_2)  # disabled
filter = StreamFilter(Gate=data, Stream1=punishment1_2)  # disabled

# ---- group: punishment2 (continued)
data_2 = Data(check_the_collision)  # disabled
filter_2 = StreamFilter(Gate=data_2, Stream1=punishment1)  # disabled

# ---- group: positive reward (continued)
subtraction = Subtraction(A=number_slider_5, B=minimum_distance)  # disabled

# ----
merge_3 = Merge(Data5=subtraction, Data6=filter, Data7=filter_2)  # -> simplify(flatten(Result)); disabled
sort = SortList(Keys=merge_3)  # -> Keys, ValuesA; disabled
lastdex = LastIndex(List=sort.Keys)  # disabled
item_2 = ListItem(List=sort.Keys, Index=0, Wrap=True)  # disabled
item_3 = ListItem(List=sort.Keys, Index=lastdex, Wrap=True)  # disabled
smaller = SmallerThan(FirstNumber=item_2, SecondNumber=0)  # -> SmallerThan, OrEqualTo; disabled
filter_3 = StreamFilter(Gate=smaller.SmallerThan, Stream0=item_3, Stream1=item_2)  # disabled

python = GhPythonScript(reset=agent.reset, observation=merge_2, reward=filter_3, done_inp=or)  # -> done_out; inputs observation: list; disabled
# ---------- python: Python ----------
"""Provides a scripting component.
    Inputs:
        x: The x script variable
        y: The y script variable
        max_len
    Output:
        a: The a output variable
        
    RETURN:
----------
    <out>
        done_out
    </out>

__author__ = "yuxi"
__version__ = "2021.06.12"""

import socket
import rhinoscriptsyntax as rs
import scriptcontext as sc


if reset:
    info = {"action_space": "gym.spaces.Discrete(6)",#agent will sent 6 actions(0,1,2,3,4,5)
        "observation_space": "gym.spaces.Box(low=-2., high=2., shape=(37,))"}#this means that the observation is a list with 37 floats whose range from -2 to 2 


sc.sticky["observation"] = observation
sc.sticky["reward"] = reward
sc.sticky["done_inp"] = done_inp
sc.sticky["info"] = info if info is not None else {}


# Send Done Through
done_out = done_inp
# ---------- end python ----------
filter_4 = StreamFilter(Gate=python, Stream0=state_of_reset, Stream1=initial_state)  # disabled

# ---- group: display of distances between each engagement and curve (continued)
resettablerecorder = ResettableDataRecorder(Data=minimum_distance, Reset=button, Clear=python)  # disabled
cull_i = CullIndex(List=resettablerecorder, Indices=0, Wrap=True)  # disabled
panel_5 = Panel(cull_i)  # disabled
gradient = Gradient(
    LowerLimit=0,
    UpperLimit=1,
    Parameter=panel_5,
    stops=[0.247: RGB(240, 248, 255), 0.497: RGB(255, 255, 0), 0.755: RGB(255, 128, 0)])  # disabled
preview = CustomPreview(Geometry=cluster2.geometry, Material=gradient)  # disabled

# ---- group: Display_sequential assembly of SL-blocks
cluster_2 = Cluster_2(text=cluster2.result)  # disabled
gradient_2 = Gradient(
    LowerLimit=0.1,
    UpperLimit=0.9,
    Parameter=cluster_2,
    stops=[0: RGB(192, 255, 255), 0.0832: RGB(128, 255, 255), 0.196: RGB(0, 255, 255), 0.199: RGB(135, 206, 250), 0.199: RGB(102, 220, 250), 0.3: RGB(176, 224, 230), 0.407: RGB(80, 193, 222), 0.477: RGB(2, 137, 186), 0.521: RGB(135, 206, 235), 0.615: RGB(73, 163, 252)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])  # disabled
preview_2 = CustomPreview(Geometry=cluster2.geometry, Material=gradient_2)  # disabled

# ----
string_of_sequential_assembly_2 = Panel(cluster2_2.result_2)
action_2 = Panel(agent_2.action)
reward_2 = Panel(filter_7)

hs_2 = HoopSnake(
    StartingData=initial_state_2,
    Data=filter_8,
    Hoopsnake_Data_autoUpdate=False,
    Hoopsnake_Data_dataLimit=2147483647,
    Hoopsnake_Data_delay=0,
    Hoopsnake_Data_resetCounter=True,
    Hoopsnake_Data_updateView=True)  # -> Feedback, CumulativeFeedback, LoopsCounter, IterationsCounter
agent_2 = GhPythonScript(iter=hs_2.IterationsCounter)  # -> action, reset; same code as agent
cluster2_2 = Cluster2(size_of_sl_block=s_2, text=hs_2.Feedback, action=agent_2.action)  # -> geometry, matrix_values_2, result_2, result

# ----
# Reset Function
# the reset function returns the environment to the initial state when the current action is not allowed.
check_the_collision_2 = CheckTheCollision(size=s_2, list=cluster2_2.geometry)

lng_2 = ListLength(List=cluster2_2.geometry)
series_2 = Series(Start=lng_2, Step=1, Count=3)
min_2 = Minimum(A=series_2, B=40)
item_4 = ListItem(List=divide_2.Points, Index=min_2, Wrap=True)
pdecon_2 = Deconstruct(Point=item_4)  # -> XComponent, YComponent, ZComponent
panel_6 = Panel(pdecon_2.XComponent)
panel_7 = Panel(pdecon_2.YComponent)
panel_8 = Panel(pdecon_2.ZComponent)
multiplication_4 = Multiplication(A=panel_6, _025=0.25)
multiplication_5 = Multiplication(A=panel_7, _025=0.25)
multiplication_6 = Multiplication(A=panel_8, _008=0.08)
merge_4 = Merge(Data1=multiplication_4, Data2=multiplication_5, Data3=multiplication_6)

cluster_3 = Cluster_3(
    list=cluster2_2.geometry,
    scale_size=s_2,
    curve=crv_2,
    first_number=hs_2.IterationsCounter,
    previous_number=cluster2_2.result)  # -> i, distance, state_of_reset_2
state_of_reset_2 = Data(cluster_3.state_of_reset_2)
minimum_distance_2 = Data(cluster_3.i)
observation_distance_2 = Data(cluster_3.distance)

# ---- group: maximum allowed distance (continued)
larger_2 = LargerThan(FirstNumber=minimum_distance_2, SecondNumber=division_8)  # -> LargerThan, OrEqualTo

# ---- group: Rest
or_3 = GateOr(A=check_the_collision_2, B=larger_2.LargerThan)

# ----
panel_9 = Panel(cluster2_2.matrix_values_2)
merge_5 = Merge(Data1=flatten(merge_4), Data2=flatten(observation_distance_2))  # -> simplify(flatten(Result))

# ---- group: punishment1 (continued)
or_4 = GateOr(A=larger_2.LargerThan)
data_3 = Data(or_4)
filter_5 = StreamFilter(Gate=data_3, Stream1=punishment1_4)

# ---- group: punishment2 (continued)
data_4 = Data(check_the_collision_2)
filter_6 = StreamFilter(Gate=data_4, Stream1=punishment1_3)

# ---- group: positive reward (continued)
subtraction_2 = Subtraction(A=number_slider_6, B=minimum_distance_2)

# ----
merge_6 = Merge(Data5=subtraction_2, Data6=filter_5, Data7=filter_6)  # -> simplify(flatten(Result))
sort_2 = SortList(Keys=merge_6)  # -> Keys, ValuesA
lastdex_2 = LastIndex(List=sort_2.Keys)
item_5 = ListItem(List=sort_2.Keys, Index=0, Wrap=True)
item_6 = ListItem(List=sort_2.Keys, Index=lastdex_2, Wrap=True)
smaller_2 = SmallerThan(FirstNumber=item_5, SecondNumber=0)  # -> SmallerThan, OrEqualTo
filter_7 = StreamFilter(Gate=smaller_2.SmallerThan, Stream0=item_6, Stream1=item_5)

lng_3 = ListLength(List=merge_5)
panel_10 = Panel(lng_3)

python_2 = GhPythonScript(reset=agent_2.reset, observation=merge_5, reward=filter_7, done_inp=or_3)  # -> done_out; inputs observation: list
# ---------- python_2: Python ----------
"""Provides a scripting component.
    Inputs:
        x: The x script variable
        y: The y script variable
        max_len
    Output:
        a: The a output variable
        
    RETURN:
----------
    <out>
        done_out
    </out>

__author__ = "yuxi"
__version__ = "2021.06.12"""

import socket
import rhinoscriptsyntax as rs
import scriptcontext as sc


if reset:
    info = {"action_space": "gym.spaces.Discrete(6)",#agent will sent 6 actions(0,1,2,3,4,5)
        "observation_space": "gym.spaces.Box(low=-2., high=2., shape=(25,))"} #this means that the observation is a list with 37 floats whose range from -2 to 2 


sc.sticky["observation"] = observation
sc.sticky["reward"] = reward
sc.sticky["done_inp"] = done_inp
sc.sticky["info"] = info if info is not None else {}


# Send Done Through
done_out = done_inp
# ---------- end python_2 ----------
filter_8 = StreamFilter(Gate=python_2, Stream0=state_of_reset_2, Stream1=initial_state_2)

# ---- group: display of distances between each engagement and curve
resettablerecorder_2 = ResettableDataRecorder(Data=minimum_distance_2, Reset=Button(), Clear=python_2)
cull_i_2 = CullIndex(List=resettablerecorder_2, Indices=0, Wrap=True)
panel_11 = Panel(cull_i_2)
gradient_3 = Gradient(
    LowerLimit=0,
    UpperLimit=1,
    Parameter=panel_11,
    stops=[0.247: RGB(240, 248, 255), 0.497: RGB(255, 255, 0), 0.755: RGB(255, 128, 0)])
preview_3 = CustomPreview(Geometry=cluster2_2.geometry, Material=gradient_3)

# ---- group: Display_sequential assembly of SL-blocks
cluster_4 = Cluster_2(text=cluster2_2.result)  # disabled
gradient_4 = Gradient(
    LowerLimit=0.1,
    UpperLimit=0.9,
    Parameter=cluster_4,
    stops=[0: RGB(192, 255, 255), 0.0832: RGB(128, 255, 255), 0.196: RGB(0, 255, 255), 0.199: RGB(135, 206, 250), 0.199: RGB(102, 220, 250), 0.3: RGB(176, 224, 230), 0.407: RGB(80, 193, 222), 0.477: RGB(2, 137, 186), 0.521: RGB(135, 206, 235), 0.615: RGB(73, 163, 252)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])  # disabled
preview_4 = CustomPreview(Geometry=cluster2_2.geometry, Material=gradient_4)  # disabled

# ----
observation_3 = Panel(merge_8)  # disabled

observation_4 = Panel(merge_11)  # disabled

string_of_sequential_assembly_3 = Panel(cluster2_3.result_2)  # disabled
action_3 = Panel(agent_3.action)  # disabled
reward_3 = Panel(filter_11)  # disabled

string_of_sequential_assembly_4 = Panel(cluster2_4.result_2)  # disabled
action_4 = Panel(agent_4.action)  # disabled
reward_4 = Panel(filter_15)  # disabled

hs_3 = HoopSnake(
    StartingData=initial_state_3,
    Data=filter_12,
    Hoopsnake_Data_autoUpdate=False,
    Hoopsnake_Data_dataLimit=2147483647,
    Hoopsnake_Data_delay=0,
    Hoopsnake_Data_resetCounter=True,
    Hoopsnake_Data_updateView=True)  # -> Feedback, CumulativeFeedback, LoopsCounter, IterationsCounter; disabled
agent_3 = GhPythonScript(iter=hs_3.IterationsCounter)  # -> action, reset; disabled; same code as agent
cluster2_3 = Cluster2(size_of_sl_block=s_3, text=hs_3.Feedback, action=agent_3.action)  # -> geometry, matrix_values_2, result_2, result; disabled

# ----
# Reset Function
# the reset function returns the environment to the initial state when the current action is not allowed.
check_the_collision_3 = CheckTheCollision(size=s_3, list=cluster2_3.geometry)  # disabled

lng_4 = ListLength(List=cluster2_3.geometry)  # disabled
series_3 = Series(Start=lng_4, Step=1, Count=3)  # disabled
min_3 = Minimum(A=series_3, B=40)  # disabled
item_7 = ListItem(List=divide_3.Points, Index=min_3, Wrap=True)  # disabled
pdecon_3 = Deconstruct(Point=item_7)  # -> XComponent, YComponent, ZComponent; disabled
panel_12 = Panel(pdecon_3.XComponent)  # disabled
panel_13 = Panel(pdecon_3.YComponent)  # disabled
panel_14 = Panel(pdecon_3.ZComponent)  # disabled
multiplication_7 = Multiplication(A=panel_12, _025=0.25)  # disabled
multiplication_8 = Multiplication(A=panel_13, _025=0.25)  # disabled
multiplication_9 = Multiplication(A=panel_14, _008=0.08)  # disabled
merge_7 = Merge(Data1=multiplication_7, Data2=multiplication_8, Data3=multiplication_9)  # disabled

cluster_5 = Cluster_3(
    list=cluster2_3.geometry,
    scale_size=s_3,
    curve=crv_3,
    first_number=hs_3.IterationsCounter,
    previous_number=cluster2_3.result)  # -> i, distance, state_of_reset_2; disabled
observation_distance_3 = Data(cluster_5.distance)  # disabled
minimum_distance_3 = Data(cluster_5.i)  # disabled
state_of_reset_3 = Data(cluster_5.state_of_reset_2)  # disabled

# ---- group: maximum allowed distance (continued)
larger_3 = LargerThan(FirstNumber=minimum_distance_3, SecondNumber=division_9)  # -> LargerThan, OrEqualTo; disabled

# ----
# Observation
panel_15 = Panel(cluster2_3.matrix_values_2)  # disabled
merge_8 = Merge(Data1=flatten(merge_7), Data2=flatten(observation_distance_3), Data3=flatten(panel_15))  # -> simplify(flatten(Result)); disabled

# ---- group: Rest
or_5 = GateOr(A=check_the_collision_3, B=larger_3.LargerThan)  # disabled

# ---- group: punishment1 (continued)
or_6 = GateOr(A=larger_3.LargerThan)  # disabled
data_5 = Data(or_6)  # disabled
filter_9 = StreamFilter(Gate=data_5, Stream1=punishment1_6)  # disabled

# ---- group: punishment2 (continued)
data_6 = Data(check_the_collision_3)  # disabled
filter_10 = StreamFilter(Gate=data_6, Stream1=punishment1_5)  # disabled

# ---- group: positive reward (continued)
subtraction_3 = Subtraction(A=number_slider_13, B=minimum_distance_3)  # disabled

# ----
merge_9 = Merge(Data5=subtraction_3, Data6=filter_9, Data7=filter_10)  # -> simplify(flatten(Result)); disabled
sort_3 = SortList(Keys=merge_9)  # -> Keys, ValuesA; disabled
lastdex_3 = LastIndex(List=sort_3.Keys)  # disabled
item_8 = ListItem(List=sort_3.Keys, Index=0, Wrap=True)  # disabled
item_9 = ListItem(List=sort_3.Keys, Index=lastdex_3, Wrap=True)  # disabled
smaller_3 = SmallerThan(FirstNumber=item_8, SecondNumber=0)  # -> SmallerThan, OrEqualTo; disabled
filter_11 = StreamFilter(Gate=smaller_3.SmallerThan, Stream0=item_9, Stream1=item_8)  # disabled

python_3 = GhPythonScript(reset=agent_3.reset, observation=merge_8, reward=filter_11, done_inp=or_5)  # -> done_out; inputs observation: list; disabled; same code as python
filter_12 = StreamFilter(Gate=python_3, Stream0=state_of_reset_3, Stream1=initial_state_3)  # disabled

# ---- group: display of distances between each engagement and curve (continued)
resettablerecorder_3 = ResettableDataRecorder(Data=minimum_distance_3, Reset=button_3, Clear=python_3)  # disabled
cull_i_3 = CullIndex(List=resettablerecorder_3, Indices=0, Wrap=True)  # disabled
panel_16 = Panel(cull_i_3)  # disabled
gradient_5 = Gradient(
    LowerLimit=0,
    UpperLimit=1,
    Parameter=panel_16,
    stops=[0.247: RGB(240, 248, 255), 0.497: RGB(255, 255, 0), 0.755: RGB(255, 128, 0)])  # disabled
preview_5 = CustomPreview(Geometry=cluster2_3.geometry, Material=gradient_5)  # disabled

# ---- group: Display_sequential assembly of SL-blocks
cluster_6 = Cluster_2(text=cluster2_3.result)  # disabled
gradient_6 = Gradient(
    LowerLimit=0.1,
    UpperLimit=0.9,
    Parameter=cluster_6,
    stops=[0: RGB(192, 255, 255), 0.0832: RGB(128, 255, 255), 0.196: RGB(0, 255, 255), 0.199: RGB(135, 206, 250), 0.199: RGB(102, 220, 250), 0.3: RGB(176, 224, 230), 0.407: RGB(80, 193, 222), 0.477: RGB(2, 137, 186), 0.521: RGB(135, 206, 235), 0.615: RGB(73, 163, 252)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])  # disabled
preview_6 = CustomPreview(Geometry=cluster2_3.geometry, Material=gradient_6)  # disabled

# ----
hs_4 = HoopSnake(
    StartingData=initial_state_4,
    Data=filter_16,
    Hoopsnake_Data_autoUpdate=False,
    Hoopsnake_Data_dataLimit=2147483647,
    Hoopsnake_Data_delay=0,
    Hoopsnake_Data_resetCounter=True,
    Hoopsnake_Data_updateView=True)  # -> Feedback, CumulativeFeedback, LoopsCounter, IterationsCounter; disabled
agent_4 = GhPythonScript(iter=hs_4.IterationsCounter)  # -> action, reset; disabled; same code as agent
cluster2_4 = Cluster2(size_of_sl_block=s_4, text=hs_4.Feedback, action=agent_4.action)  # -> geometry, matrix_values_2, result_2, result; disabled

# ----
# Reset Function
# the reset function returns the environment to the initial state when the current action is not allowed.
check_the_collision_4 = CheckTheCollision(size=s_4, list=cluster2_4.geometry)  # disabled

lng_5 = ListLength(List=cluster2_4.geometry)  # disabled
series_4 = Series(Start=lng_5, Step=1, Count=3)  # disabled
min_4 = Minimum(A=series_4, B=40)  # disabled
item_10 = ListItem(List=divide_4.Points, Index=min_4, Wrap=True)  # disabled
pdecon_4 = Deconstruct(Point=item_10)  # -> XComponent, YComponent, ZComponent; disabled
panel_17 = Panel(pdecon_4.XComponent)  # disabled
panel_18 = Panel(pdecon_4.YComponent)  # disabled
panel_19 = Panel(pdecon_4.ZComponent)  # disabled
multiplication_10 = Multiplication(A=panel_17, _025=0.25)  # disabled
multiplication_11 = Multiplication(A=panel_18, _025=0.25)  # disabled
multiplication_12 = Multiplication(A=panel_19, _008=0.08)  # disabled
merge_10 = Merge(Data1=multiplication_10, Data2=multiplication_11, Data3=multiplication_12)  # disabled

cluster_7 = Cluster_3(
    list=cluster2_4.geometry,
    scale_size=s_4,
    curve=crv_4,
    first_number=hs_4.IterationsCounter,
    previous_number=cluster2_4.result)  # -> i, distance, state_of_reset_2; disabled
state_of_reset_4 = Data(cluster_7.state_of_reset_2)  # disabled
minimum_distance_4 = Data(cluster_7.i)  # disabled
observation_distance_4 = Data(cluster_7.distance)  # disabled

# ----
# Observation
panel_20 = Panel(cluster2_4.matrix_values_2)  # disabled
merge_11 = Merge(Data1=flatten(merge_10), Data2=flatten(observation_distance_4), Data3=flatten(panel_20))  # -> simplify(flatten(Result)); disabled

# ---- group: maximum allowed distance (continued)
larger_4 = LargerThan(FirstNumber=minimum_distance_4, SecondNumber=division_10)  # -> LargerThan, OrEqualTo; disabled

# ---- group: Rest
or_7 = GateOr(A=check_the_collision_4, B=larger_4.LargerThan)  # disabled

# ---- group: punishment1 (continued)
or_8 = GateOr(A=larger_4.LargerThan)  # disabled
data_7 = Data(or_8)  # disabled
filter_13 = StreamFilter(Gate=data_7, Stream1=punishment1_8)  # disabled

# ---- group: punishment2 (continued)
data_8 = Data(check_the_collision_4)  # disabled
filter_14 = StreamFilter(Gate=data_8, Stream1=punishment1_7)  # disabled

# ---- group: positive reward (continued)
subtraction_4 = Subtraction(A=number_slider_14, B=minimum_distance_4)  # disabled

# ----
merge_12 = Merge(Data5=subtraction_4, Data6=filter_13, Data7=filter_14)  # -> simplify(flatten(Result)); disabled
sort_4 = SortList(Keys=merge_12)  # -> Keys, ValuesA; disabled
lastdex_4 = LastIndex(List=sort_4.Keys)  # disabled
item_11 = ListItem(List=sort_4.Keys, Index=0, Wrap=True)  # disabled
item_12 = ListItem(List=sort_4.Keys, Index=lastdex_4, Wrap=True)  # disabled
smaller_4 = SmallerThan(FirstNumber=item_11, SecondNumber=0)  # -> SmallerThan, OrEqualTo; disabled
filter_15 = StreamFilter(Gate=smaller_4.SmallerThan, Stream0=item_12, Stream1=item_11)  # disabled

python_4 = GhPythonScript(reset=agent_4.reset, observation=merge_11, reward=filter_15, done_inp=or_7)  # -> done_out; inputs observation: list; disabled
# ---------- python_4: Python ----------
"""Provides a scripting component.
    Inputs:
        x: The x script variable
        y: The y script variable
        max_len
    Output:
        a: The a output variable
        
    RETURN:
----------
    <out>
        done_out
    </out>

__author__ = "yuxi"
__version__ = "2021.06.12"""

import socket
import rhinoscriptsyntax as rs
import scriptcontext as sc

if reset:
    info = {"action_space": "gym.spaces.Discrete(6)",#agent will sent 6 actions(0,1,2,3,4,5)
        "observation_space": "gym.spaces.Box(low=-2., high=2., shape=(37,))"}#this means that the observation is a list with 37 floats whose range from -2 to 2 


sc.sticky["observation"] = observation
sc.sticky["reward"] = reward
sc.sticky["done_inp"] = done_inp
sc.sticky["info"] = info if info is not None else {}


# Send Done Through
done_out = done_inp
# ---------- end python_4 ----------
filter_16 = StreamFilter(Gate=python_4, Stream0=state_of_reset_4, Stream1=initial_state_4)  # disabled

# ---- group: display of distances between each engagement and curve (continued)
resettablerecorder_4 = ResettableDataRecorder(Data=minimum_distance_4, Reset=button_2, Clear=python_4)  # disabled
cull_i_4 = CullIndex(List=resettablerecorder_4, Indices=0, Wrap=True)  # disabled
panel_21 = Panel(cull_i_4)  # disabled
gradient_7 = Gradient(
    LowerLimit=0,
    UpperLimit=1,
    Parameter=panel_21,
    stops=[0.247: RGB(240, 248, 255), 0.497: RGB(255, 255, 0), 0.755: RGB(255, 128, 0)])  # disabled
preview_7 = CustomPreview(Geometry=cluster2_4.geometry, Material=gradient_7)  # disabled

# ---- group: Display_sequential assembly of SL-blocks
cluster_8 = Cluster_2(text=cluster2_4.result)  # disabled
gradient_8 = Gradient(
    LowerLimit=0.1,
    UpperLimit=0.9,
    Parameter=cluster_8,
    stops=[0: RGB(192, 255, 255), 0.0832: RGB(128, 255, 255), 0.196: RGB(0, 255, 255), 0.199: RGB(135, 206, 250), 0.199: RGB(102, 220, 250), 0.3: RGB(176, 224, 230), 0.407: RGB(80, 193, 222), 0.477: RGB(2, 137, 186), 0.521: RGB(135, 206, 235), 0.615: RGB(73, 163, 252)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])  # disabled
preview_8 = CustomPreview(Geometry=cluster2_4.geometry, Material=gradient_8)  # disabled

# ----
observation_5 = Panel(merge_14)  # disabled

observation_6 = Panel(merge_17)  # disabled

string_of_sequential_assembly_5 = Panel(cluster2_5.result_2)  # disabled
action_5 = Panel(agent_5.action)  # disabled
reward_5 = Panel(filter_19)  # disabled

string_of_sequential_assembly_6 = Panel(cluster2_6.result_2)  # disabled
action_6 = Panel(agent_6.action)  # disabled
reward_6 = Panel(filter_23)  # disabled

hs_5 = HoopSnake(
    StartingData=initial_state_5,
    Data=filter_20,
    Hoopsnake_Data_autoUpdate=False,
    Hoopsnake_Data_dataLimit=2147483647,
    Hoopsnake_Data_delay=0,
    Hoopsnake_Data_resetCounter=True,
    Hoopsnake_Data_updateView=True)  # -> Feedback, CumulativeFeedback, LoopsCounter, IterationsCounter; disabled
agent_5 = GhPythonScript(iter=hs_5.IterationsCounter)  # -> action, reset; disabled; same code as agent
cluster2_5 = Cluster2(size_of_sl_block=s_5, text=hs_5.Feedback, action=agent_5.action)  # -> geometry, matrix_values_2, result_2, result; disabled

# ----
# Reset Function
# the reset function returns the environment to the initial state when the current action is not allowed.
check_the_collision_5 = CheckTheCollision(size=s_5, list=cluster2_5.geometry)  # disabled

lng_6 = ListLength(List=cluster2_5.geometry)  # disabled
series_5 = Series(Start=lng_6, Step=1, Count=3)  # disabled
min_5 = Minimum(A=series_5, B=40)  # disabled
item_13 = ListItem(List=shift, Index=min_5, Wrap=True)  # disabled
pdecon_5 = Deconstruct(Point=item_13)  # -> XComponent, YComponent, ZComponent; disabled
panel_22 = Panel(pdecon_5.XComponent)  # disabled
panel_23 = Panel(pdecon_5.YComponent)  # disabled
panel_24 = Panel(pdecon_5.ZComponent)  # disabled
multiplication_13 = Multiplication(A=panel_22, _025=0.25)  # disabled
multiplication_14 = Multiplication(A=panel_23, _025=0.25)  # disabled
multiplication_15 = Multiplication(A=panel_24, _008=0.08)  # disabled
merge_13 = Merge(Data1=multiplication_13, Data2=multiplication_14, Data3=multiplication_15)  # disabled

cluster_9 = Cluster_3(
    list=cluster2_5.geometry,
    scale_size=s_5,
    curve=crv_5,
    first_number=hs_5.IterationsCounter,
    previous_number=cluster2_5.result)  # -> i, distance, state_of_reset_2; disabled
minimum_distance_5 = Data(cluster_9.i)  # disabled
state_of_reset_5 = Data(cluster_9.state_of_reset_2)  # disabled
observation_distance_5 = Data(cluster_9.distance)  # disabled

# ----
# Observation
panel_25 = Panel(cluster2_5.matrix_values_2)  # disabled
merge_14 = Merge(Data1=flatten(merge_13), Data2=flatten(observation_distance_5), Data3=flatten(panel_25))  # -> simplify(flatten(Result)); disabled

# ---- group: maximum allowed distance (continued)
larger_5 = LargerThan(FirstNumber=minimum_distance_5, SecondNumber=division_11)  # -> LargerThan, OrEqualTo; disabled

# ---- group: Rest
or_9 = GateOr(A=check_the_collision_5, B=larger_5.LargerThan)  # disabled

# ---- group: punishment1 (continued)
or_10 = GateOr(A=larger_5.LargerThan)  # disabled
data_9 = Data(or_10)  # disabled
filter_17 = StreamFilter(Gate=data_9, Stream1=punishment1_11)  # disabled

# ---- group: punishment2 (continued)
data_10 = Data(check_the_collision_5)  # disabled
filter_18 = StreamFilter(Gate=data_10, Stream1=punishment1_9)  # disabled

# ---- group: positive reward (continued)
subtraction_5 = Subtraction(A=number_slider_23, B=minimum_distance_5)  # disabled

# ----
merge_15 = Merge(Data5=subtraction_5, Data6=filter_17, Data7=filter_18)  # -> simplify(flatten(Result)); disabled
sort_5 = SortList(Keys=merge_15)  # -> Keys, ValuesA; disabled
lastdex_5 = LastIndex(List=sort_5.Keys)  # disabled
item_14 = ListItem(List=sort_5.Keys, Index=0, Wrap=True)  # disabled
item_15 = ListItem(List=sort_5.Keys, Index=lastdex_5, Wrap=True)  # disabled
smaller_5 = SmallerThan(FirstNumber=item_14, SecondNumber=0)  # -> SmallerThan, OrEqualTo; disabled
filter_19 = StreamFilter(Gate=smaller_5.SmallerThan, Stream0=item_15, Stream1=item_14)  # disabled

python_5 = GhPythonScript(reset=agent_5.reset, observation=merge_14, reward=filter_19, done_inp=or_9)  # -> done_out; inputs observation: list; disabled
# ---------- python_5: Python ----------
"""Provides a scripting component.
    Inputs:
        x: The x script variable
        y: The y script variable
        max_len
    Output:
        a: The a output variable
        
    RETURN:
----------
    <out>
        done_out
    </out>

__author__ = "yuxi"
__version__ = "2021.06.12"""

import socket
import rhinoscriptsyntax as rs
import scriptcontext as sc

if reset:
    info = {"action_space": "gym.spaces.Discrete(6)",#agent will sent 6 actions(0,1,2,3,4,5)
        "observation_space": "gym.spaces.Box(low=-2., high=2., shape=(37,))"}#this means that the observation is a list with 37 floats whose range from -2 to 2 

sc.sticky["observation"] = observation
sc.sticky["reward"] = reward
sc.sticky["done_inp"] = done_inp
sc.sticky["info"] = info if info is not None else {}


# Send Done Through
done_out = done_inp
# ---------- end python_5 ----------
filter_20 = StreamFilter(Gate=python_5, Stream0=state_of_reset_5, Stream1=initial_state_5)  # disabled

# ---- group: Display_sequential assembly of SL-blocks
cluster_10 = Cluster_2(text=cluster2_5.result)  # disabled
gradient_9 = Gradient(
    LowerLimit=0.1,
    UpperLimit=0.9,
    Parameter=cluster_10,
    stops=[0: RGB(192, 255, 255), 0.0832: RGB(128, 255, 255), 0.196: RGB(0, 255, 255), 0.199: RGB(135, 206, 250), 0.199: RGB(102, 220, 250), 0.3: RGB(176, 224, 230), 0.407: RGB(80, 193, 222), 0.477: RGB(2, 137, 186), 0.521: RGB(135, 206, 235), 0.615: RGB(73, 163, 252)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])  # disabled
preview_9 = CustomPreview(Geometry=cluster2_5.geometry, Material=gradient_9)  # disabled

# ---- group: display of distances between each engagement and curve (continued)
resettablerecorder_5 = ResettableDataRecorder(Data=minimum_distance_5, Reset=button_5, Clear=python_5)  # disabled
cull_i_5 = CullIndex(List=resettablerecorder_5, Indices=0, Wrap=True)  # disabled
panel_26 = Panel(cull_i_5)  # disabled
gradient_10 = Gradient(
    LowerLimit=0,
    UpperLimit=1,
    Parameter=panel_26,
    stops=[0.247: RGB(240, 248, 255), 0.497: RGB(255, 255, 0), 0.755: RGB(255, 128, 0)])  # disabled
preview_10 = CustomPreview(Geometry=cluster2_5.geometry, Material=gradient_10)  # disabled

# ----
hs_6 = HoopSnake(
    StartingData=initial_state_6,
    Data=filter_24,
    Hoopsnake_Data_autoUpdate=False,
    Hoopsnake_Data_dataLimit=2147483647,
    Hoopsnake_Data_delay=0,
    Hoopsnake_Data_resetCounter=True,
    Hoopsnake_Data_updateView=True)  # -> Feedback, CumulativeFeedback, LoopsCounter, IterationsCounter; disabled
agent_6 = GhPythonScript(iter=hs_6.IterationsCounter)  # -> action, reset; disabled; same code as agent
cluster2_6 = Cluster2(size_of_sl_block=s_6, text=hs_6.Feedback, action=agent_6.action)  # -> geometry, matrix_values_2, result_2, result; disabled

# ----
# Reset Function
# the reset function returns the environment to the initial state when the current action is not allowed.
check_the_collision_6 = CheckTheCollision(size=s_6, list=cluster2_6.geometry)  # disabled

lng_7 = ListLength(List=cluster2_6.geometry)  # disabled
series_6 = Series(Start=lng_7, Step=1, Count=3)  # disabled
min_6 = Minimum(A=series_6, B=40)  # disabled
item_16 = ListItem(List=shift_2, Index=min_6, Wrap=True)  # disabled
pdecon_6 = Deconstruct(Point=item_16)  # -> XComponent, YComponent, ZComponent; disabled
panel_27 = Panel(pdecon_6.XComponent)  # disabled
panel_28 = Panel(pdecon_6.YComponent)  # disabled
panel_29 = Panel(pdecon_6.ZComponent)  # disabled
multiplication_16 = Multiplication(A=panel_27, _025=0.25)  # disabled
multiplication_17 = Multiplication(A=panel_28, _025=0.25)  # disabled
multiplication_18 = Multiplication(A=panel_29, _008=0.08)  # disabled
merge_16 = Merge(Data1=multiplication_16, Data2=multiplication_17, Data3=multiplication_18)  # disabled

cluster_11 = Cluster_3(
    list=cluster2_6.geometry,
    scale_size=s_6,
    curve=crv_6,
    first_number=hs_6.IterationsCounter,
    previous_number=cluster2_6.result)  # -> i, distance, state_of_reset_2; disabled
state_of_reset_6 = Data(cluster_11.state_of_reset_2)  # disabled
minimum_distance_6 = Data(cluster_11.i)  # disabled
observation_distance_6 = Data(cluster_11.distance)  # disabled

# ----
# Observation
panel_30 = Panel(cluster2_6.matrix_values_2)  # disabled
merge_17 = Merge(Data1=flatten(merge_16), Data2=flatten(observation_distance_6), Data3=flatten(panel_30))  # -> simplify(flatten(Result)); disabled

# ---- group: maximum allowed distance (continued)
larger_6 = LargerThan(FirstNumber=minimum_distance_6, SecondNumber=division_12)  # -> LargerThan, OrEqualTo; disabled

# ---- group: Rest
or_11 = GateOr(A=check_the_collision_6, B=larger_6.LargerThan)  # disabled

# ---- group: punishment1 (continued)
or_12 = GateOr(A=larger_6.LargerThan)  # disabled
data_11 = Data(or_12)  # disabled
filter_21 = StreamFilter(Gate=data_11, Stream1=punishment1_12)  # disabled

# ---- group: punishment2 (continued)
data_12 = Data(check_the_collision_6)  # disabled
filter_22 = StreamFilter(Gate=data_12, Stream1=punishment1_10)  # disabled

# ---- group: positive reward (continued)
subtraction_6 = Subtraction(A=number_slider_24, B=minimum_distance_6)  # disabled

# ----
merge_18 = Merge(Data5=subtraction_6, Data6=filter_21, Data7=filter_22)  # -> simplify(flatten(Result)); disabled
sort_6 = SortList(Keys=merge_18)  # -> Keys, ValuesA; disabled
lastdex_6 = LastIndex(List=sort_6.Keys)  # disabled
item_17 = ListItem(List=sort_6.Keys, Index=0, Wrap=True)  # disabled
item_18 = ListItem(List=sort_6.Keys, Index=lastdex_6, Wrap=True)  # disabled
smaller_6 = SmallerThan(FirstNumber=item_17, SecondNumber=0)  # -> SmallerThan, OrEqualTo; disabled
filter_23 = StreamFilter(Gate=smaller_6.SmallerThan, Stream0=item_18, Stream1=item_17)  # disabled

python_6 = GhPythonScript(reset=agent_6.reset, observation=merge_17, reward=filter_23, done_inp=or_11)  # -> done_out; inputs observation: list; disabled; same code as python_4
filter_24 = StreamFilter(Gate=python_6, Stream0=state_of_reset_6, Stream1=initial_state_6)  # disabled

# ---- group: Display_sequential assembly of SL-blocks
cluster_12 = Cluster_2(text=cluster2_6.result)  # disabled
gradient_11 = Gradient(
    LowerLimit=0.1,
    UpperLimit=0.9,
    Parameter=cluster_12,
    stops=[0: RGB(192, 255, 255), 0.0832: RGB(128, 255, 255), 0.196: RGB(0, 255, 255), 0.199: RGB(135, 206, 250), 0.199: RGB(102, 220, 250), 0.3: RGB(176, 224, 230), 0.407: RGB(80, 193, 222), 0.477: RGB(2, 137, 186), 0.521: RGB(135, 206, 235), 0.615: RGB(73, 163, 252)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])  # disabled
preview_11 = CustomPreview(Geometry=cluster2_6.geometry, Material=gradient_11)  # disabled

# ---- group: display of distances between each engagement and curve (continued)
resettablerecorder_6 = ResettableDataRecorder(Data=minimum_distance_6, Reset=button_4, Clear=python_6)  # disabled
cull_i_6 = CullIndex(List=resettablerecorder_6, Indices=0, Wrap=True)  # disabled
panel_31 = Panel(cull_i_6)  # disabled
gradient_12 = Gradient(
    LowerLimit=0,
    UpperLimit=1,
    Parameter=panel_31,
    stops=[0.247: RGB(240, 248, 255), 0.497: RGB(255, 255, 0), 0.755: RGB(255, 128, 0)])  # disabled
preview_12 = CustomPreview(Geometry=cluster2_6.geometry, Material=gradient_12)  # disabled

# ==== cluster Cluster2
text = ClusterInput()

# ---- group: action
actions = Panel("""h
a
d
s
t
y""")
cset = CreateSet(List=actions)  # -> Set, Map

# ----
action = ClusterInput()
size_of_sl_block = ClusterInput()

# ---- group: action
actions_2 = Panel("""h
a
d
s
t
y""")
cset_2 = CreateSet(List=actions_2)  # -> Set, Map

# ----
characters = Characters(Text=text)  # -> flatten(Result), Unicode
list_item = ListItem(List=cset.Set, Action=action, Wrap=False)
concatenate = Concatenate(FragmentA=text, FragmentB=action)
list_item_2 = ListItem(List=cset_2.Set, Action=characters.Result, Wrap=False)
text_join = TextJoin(Text=list_item_2)
result = ClusterOutput(concatenate)
concatenate_2 = Concatenate(FragmentA=text_join, FragmentB=list_item)  # -> simplify(Result)

# ---- group: tansformation rules of SL-blocks
cluster = Cluster()
transform = Transform(cluster)

# ----
rules = Panel("""i
h
a
d
s
t
y""")
characters_2 = Characters(Text=concatenate_2)  # -> flatten(Result), Unicode
cset_3 = CreateSet(List=rules)  # -> Set, Map
mindex = MemberIndex(Set=cset_3.Set, Member=characters_2.Result)  # -> flatten(Index), Count
item = ListItem(List=transform, Index=mindex.Index, Wrap=True)

result_2 = ClusterOutput(concatenate_2)
c_script = CSharpScript(transX=item)  # -> out, TransformList; inputs transX: list of Transform
# ---------- c_script: C# ----------
    List < Transform > nTransX = new List <Transform>();

    Transform tx = Transform.Identity;
    for (int i = 0; i < transX.Count; i++)
    {
      tx = Transform.Multiply(tx, transX[i]);
      nTransX.Add(tx);
    }

    TransformList = nTransX;
# ---------- c_script: C# additional code ----------
  /// <summary>
  /// This method will be called once every solution, before any calls to RunScript.
  /// </summary>
  public override void BeforeRunScript()
  { }
  /// <summary>
  /// This method will be called once every solution, after any calls to RunScript.
  /// </summary>
  public override void AfterRunScript()
  { }
# ---------- end c_script ----------

# ---- group: choose model
list = ValueList({"0", "1"}, selected="0")
simple_sl = Geometry(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)
refined_sl = Geometry(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)
p_n_c = PickNChoose(Pattern=list, Stream0=simple_sl, Stream1=refined_sl)

# ----
last_index = LastIndex(List=c_script.TransformList)
list_item_3 = ListItem(List=c_script.TransformList, Index=last_index, Wrap=True)
transform_2 = Transform(Geometry=p_n_c, Transform=c_script.TransformList)
panel = Panel("""0
0
0
1""")
transform_matrix = TransformMatrix(list_item_3, Digits=2)
size_of_sl_block_2 = Panel(size_of_sl_block)
construct_matrix = ConstructMatrix(Rows=Slider(4, range=0..10), Columns=Slider(1, range=0..1), Values=panel)
scale = Scale(Geometry=transform_2, Center=Point(0, 0, 0), SizeOfSLBlock=size_of_sl_block)  # -> Geometry, Transform
panel_2 = Panel("""1
0
0
0
1
0
0
0
1
0
0
0""")
construct_matrix_2 = ConstructMatrix(Rows=Slider(4, range=0..10), Columns=Slider(3, range=0..10), Values=panel_2)
matrixmultiply = MatrixMultiply(Matrix1=transform_matrix, Matrix2=construct_matrix)
geometry = ClusterOutput(scale.Geometry)
transpose_matrix = TransposeMatrix(Matrix=construct_matrix_2)
multiplication = Multiplication(A=matrixmultiply, B=size_of_sl_block_2)
matrixmultiply_2 = MatrixMultiply(Matrix1=transform_matrix, Matrix2=construct_matrix_2)
panel_3 = Panel("""0.25
0
0
0
0.25
0
0
0
0.08""")
matrixmultiply_3 = MatrixMultiply(Matrix1=transpose_matrix, Matrix2=matrixmultiply_2)
matrixmultiply_4 = MatrixMultiply(Matrix1=transpose_matrix, Matrix2=multiplication)
construct_matrix_3 = ConstructMatrix(Rows=Slider(3, range=0..10), Columns=Slider(3, range=0..3), Values=panel_3)
matrixmultiply_5 = MatrixMultiply(Matrix1=construct_matrix_3, Matrix2=matrixmultiply_4)
deconstruct_matrix = DeconstructMatrix(Matrix=matrixmultiply_3)  # -> Rows, Columns, Values
deconstruct_matrix_2 = DeconstructMatrix(Matrix=matrixmultiply_5)  # -> Rows, Columns, Values
merge = Merge(Data1=deconstruct_matrix_2.Values, Data2=deconstruct_matrix.Values)  # -> flatten(Result)
matrix_values = Data(merge)
panel_4 = Panel(merge)
matrix_values_2 = ClusterOutput(matrix_values)

# ==== cluster CheckTheCollision
list = ClusterInput()
list_length = ListLength(List=list)
list_length_2 = ListLength(List=list)
subtraction = Subtraction(A=list_length, B=Slider(1, range=0..10))
negative = Negative(Value=Slider(1, range=0..2))
size = ClusterInput()
equals = Equality(FirstNumber=list_length_2, SecondNumber=1)  # -> Equality, Inequality
list_item = ListItem(List=list, Index=subtraction, Wrap=True)
shift_list = ShiftList(List=list, Shift=negative, Wrap=False)
filter = StreamFilter(Gate=equals.Inequality, Stream1=list_item)
ungroup = Ungroup(Group=shift_list)
ungroup_2 = Ungroup(Group=filter)
voxelize_geometry = VoxelizeGeometry(Geometry=ungroup, Size=size)  # -> flatten(Mesh)
voxelize_geometry_2 = VoxelizeGeometry(Geometry=ungroup_2, Size=size)  # -> flatten(Mesh)
volume = Volume(Geometry=voxelize_geometry)  # -> Volume, simplify(Centroid)
volume_2 = Volume(Geometry=voxelize_geometry_2)  # -> Volume, simplify(Centroid)
intersection = SetIntersection(SetA=volume.Centroid, SetB=volume_2.Centroid)
lng = ListLength(List=intersection)
larger_than = LargerThan(FirstNumber=lng, SecondNumber=Slider(1, range=-1..2))  # -> LargerThan, OrEqualTo
larger_than_2 = ClusterOutput(larger_than.LargerThan)

# ==== cluster Cluster_2
text = ClusterInput()

# ---- group: Display
characters = Characters(Text=text)  # -> flatten(Result), Unicode
list_length = ListLength(List=characters.Result)
construct_domain = ConstructDomain(DomainStart=0, DomainEnd=list_length)
series = Series(Start=0, Step=1, Count=list_length)
remap_numbers = RemapNumbers(Value=series, Source=construct_domain, Target=Domain(0, 1))  # -> Mapped, Clipped

# ----
mapped = ClusterOutput(remap_numbers.Mapped)

# ==== cluster Cluster_3
first_number = ClusterInput()
curve = ClusterInput()
scale_size = ClusterInput()
list = ClusterInput()
reparameterize_curve = ReparameterizeCurve(Curve=curve)  # -> Reparameterized, Original
last_index = LastIndex(List=list)
previous_number = ClusterInput()
list_item = ListItem(List=list, Index=last_index, Wrap=True)
equality = Equality(FirstNumber=first_number, SecondNumber=Slider(0, range=0..100))  # -> Equality, Inequality
previous_number_2 = Data(previous_number)

# ---- group: observation
ungroup = Ungroup(Group=list_item)
voxelize_geometry = VoxelizeGeometry(Geometry=ungroup, ScaleSize=scale_size)
volume = Volume(Geometry=voxelize_geometry)  # -> Volume, CenterOfVoxels

# ----
stream_filter = StreamFilter(Gate=equality.Equality, Stream0=previous_number_2, Stream1=Slider(0, range=0..100))
state_of_reset = Data(stream_filter)
state_of_reset_2 = ClusterOutput(state_of_reset)
curve_closest_point = CurveClosestPoint(Point=flatten(volume.CenterOfVoxels), Curve=reparameterize_curve.Reparameterized)  # -> Point, Parameter, Distance
sort_list = SortList(Keys=curve_closest_point.Distance)  # -> Keys, ValuesValuesA
distance = ClusterOutput(curve_closest_point.Distance)
list_item_2 = ListItem(List=sort_list.Keys, Index=0, Wrap=True)
i = ClusterOutput(list_item_2)

# ==== cluster TargetCurves
_2d_curve_short = Curve(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)
_2d_curve_long = Curve(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)
_3d_curve_open_short = Curve(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)
_3d_curve_open_long = Curve(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)
_3d_curve_closed_short = Curve(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)
_3d_curve_closed_long = Curve(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)
_2d_curve_short_2 = ClusterOutput(_2d_curve_short)
_2d_curve_long_2 = ClusterOutput(_2d_curve_long)
_3d_curve_open_short_2 = ClusterOutput(_3d_curve_open_short)
_3d_curve_closed_short_2 = ClusterOutput(_3d_curve_closed_short)
_3d_curve_closed_long_2 = ClusterOutput(_3d_curve_closed_long)
_3d_curve_open_long_2 = ClusterOutput(_3d_curve_open_long)

# ==== cluster Cluster

# ---- group: y
yz = YZPlane(Origin=Point(0, 0, 0))
pi = Pi(Factor=1)
xy = XYPlane(Origin=Point(0, 0, 0))
pi_2 = Pi(Factor="0.5")
vec = VectorXYZ(XComponent="1", YComponent="1", ZComponent="-2")  # -> Vector, Length
rotate = Rotate(Angle=pi, Plane=yz)  # -> Geometry, Transform
rotate_2 = Rotate(Angle=pi_2, Plane=xy)  # -> Geometry, Transform
move = Move(Motion=vec.Vector)  # -> Geometry, Transform
merge = Merge(Data1=rotate_2.Transform, Data2=move.Transform)
comp = Compound(Transforms=merge)

# ---- group: s
yz_2 = YZPlane(Origin=Point(0, 0, 0))
pi_3 = Pi(Factor=1)
pi_4 = Pi(Factor="0.5")
xy_2 = XYPlane(Origin=Point(0, 0, 0))
vec_2 = VectorXYZ(XComponent="1", YComponent="1", ZComponent="-1")  # -> Vector, Length
rotate_3 = Rotate(Angle=pi_3, Plane=yz_2)  # -> Geometry, Transform
rotate_4 = Rotate(Angle=pi_4, Plane=xy_2)  # -> Geometry, Transform
move_2 = Move(Motion=vec_2.Vector)  # -> Geometry, Transform
merge_2 = Merge(Data1=rotate_3.Transform, Data2=rotate_4.Transform, Data3=move_2.Transform)
comp_2 = Compound(Transforms=merge_2)

# ---- group: t
yz_3 = YZPlane(Origin=Point(0, 0, 0))
pi_5 = Pi(Factor=1)
pi_6 = Pi(Factor="-0.5")
xy_3 = XYPlane(Origin=Point(0, 0, 0))
vec_3 = VectorXYZ(XComponent="1", YComponent="-1", ZComponent="1")  # -> Vector, Length
rotate_5 = Rotate(Angle=pi_5, Plane=yz_3)  # -> Geometry, Transform
rotate_6 = Rotate(Angle=pi_6, Plane=xy_3)  # -> Geometry, Transform
move_3 = Move(Motion=vec_3.Vector)  # -> Geometry, Transform
merge_3 = Merge(Data1=rotate_5.Transform, Data2=rotate_6.Transform, Data3=move_3.Transform)
comp_3 = Compound(Transforms=merge_3)

# ----
matrix = Matrix(graft([{0;0=1, 0;1=0, 0;2=0, 0;3=0, 1;0=0, 1;1=1, 1;2=0, 1;3=0, 2;0=0, 2;1=0, 2;2=1, 2;3=0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}, {0;0=1, 0;1=0, 0;2=0, 0;3=2, 1;0=0, 1;1=-1, 1;2=0, 1;3=0, 2;0=0, 2;1=0, 2;2=-1, 2;3=0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}, {0;0=0, 0;1=1, 0;2=0, 0;3=1, 1;0=-1, 1;1=0, 1;2=0, 1;3=-1, 2;0=0, 2;1=0, 2;2=1, 2;3=0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}, {0;0=1, 0;1=0, 0;2=0, 0;3=2, 1;0=0, 1;1=1, 1;2=0, 1;3=0, 2;0=0, 2;1=0, 2;2=1, 2;3=-1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}, {0;0=0, 0;1=1, 0;2=0, 0;3=1, 1;0=-1, 1;1=0, 1;2=0, 1;3=1, 2;0=0, 2;1=0, 2;2=1, 2;3=-1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}, {0;0=0, 0;1=-1, 0;2=0, 0;3=1, 1;0=1, 1;1=0, 1;2=0, 1;3=-1, 2;0=0, 2;1=0, 2;2=1, 2;3=1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}, {0;0=0, 0;1=-1, 0;2=0, 0;3=1, 1;0=1, 1;1=0, 1;2=0, 1;3=1, 2;0=0, 2;1=0, 2;2=1, 2;3=-2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}]))
bang = ExplodeTree(Data=matrix)  # -> flatten(Branch0), flatten(Branch1), flatten(Branch2), flatten(Branch3), flatten(Branch4), flatten(Branch5), flatten(Branch6)
transform = Transform(bang.Branch2)
transform_2 = Transform(bang.Branch0)
transform_3 = Transform(bang.Branch1)
transform_4 = Transform(bang.Branch3)
transform_5 = Transform(comp_2)
transform_6 = Transform(comp_3)
transform_7 = Transform(comp)
merge_4 = Merge(
    Data1=transform_2,
    Data2=transform_3,
    Data3=transform,
    Data4=transform_4,
    Data5=transform_5,
    Data6=transform_6,
    Data7=transform_7)  # -> flatten(Result)
R = ClusterOutput(merge_4)
